# Grasshopper definition cubes.gh (Grasshopper 1.0.7)

python = GhPythonScript(x=Slider(8, range=0..10), y=Slider(9, range=0..10), z=Slider(8, range=0..10), r=Slider(5, range=0..10))  # -> out, b, a
# ---------- python: Python ----------
import rhinoscriptsyntax as rs
import Rhino

import random as rnd

def MidPt(PT01, PT02):
    MidPt = None
    MidPt = [(PT01[0] + PT02[0]) / 2,
    (PT01[1] + PT02[1]) / 2,
    (PT01[2] + PT02[2]) / 2,]
    return MidPt
    
def box2pt(p1, p2):
    pt0 = p1
    pt1 = rs.coerce3dpoint([p2[0], p1[1], p1[2]])
    pt2 = rs.coerce3dpoint([p2[0], p2[1], p1[2]])
    pt3 = rs.coerce3dpoint([p1[0], p2[1], p1[2]])
    pt4 = rs.coerce3dpoint([p1[0], p1[1], p2[2]])
    pt5 = rs.coerce3dpoint([p2[0], p1[1], p2[2]])
    pt6 = p2
    pt7 = rs.coerce3dpoint([p1[0], p2[1], p2[2]])
    rs.AddBox([pt0, pt1, pt2, pt3, pt4, pt5, pt6, pt7])
    return rs.AddBox([pt0, pt1, pt2, pt3, pt4, pt5, pt6, pt7])

#set up empty lists
ptMtx = {}
lines = []
midPts = []
boxes = []
print(type(a))

#loop through point list and generate lines - save in list
for i in range(0, int(x), 2):
    for j in range(0, int(y), 2):
        for k in range(1, int(z), 2):
            if i > 0 and j > 0 and k > 0:
                p1 = (i,j,k)
                p2 = (i+2, j+2, k+2)
                box = box2pt(p1, p2)
                boxes.append(box)
                
for i in range(len(boxes)):
    bbox = rs.BoundingBox(boxes[i])
    point = rs.PointAdd(bbox[4], bbox[0])
    print(point)
    center = rs.PointDivide(point, 2.0)
    rs.RotateObject(boxes[i], center, point[2]*r, Rhino.Geometry.Vector3d.ZAxis)

a = boxes
# ---------- end python ----------
