# Grasshopper definition sphere.gh (Grasshopper 1.0.7)

python = GhPythonScript(x=Slider(1, range=0..1), y=Slider(0.991, range=0..1), r=Slider(0.778, range=0..1))  # -> out, b, a
# ---------- python: Python ----------
__author__ = "pato"

import rhinoscriptsyntax as rs
print(x, y)

    
a = rs.CreatePoint((x,y,0))
b = r
# ---------- end python ----------
sph = Sphere(Base=python.a, Radius=python.b)
